# Grasshopper definition Mesh-Voronoi.gh (Grasshopper 1.0.7)
# plug-ins: Weaverbird

geometry = Geometry(<brep referenced from the Rhino model>)
populate_3d = Populate3D(Region=geometry, Count=Slider(43, range=0..100), Seed=Slider(6, range=1..10))
voronoi_3d = Voronoi3D(Points=populate_3d, Box=geometry)  # -> Cells, Boundary
list_item = ListItem(List=populate_3d, Index=0, Wrap=True)  # -> Item, Item1, Item2
interpolate = Interpolate(Vertices=[list_item.Item, list_item.Item1, list_item.Item2], Degree=3, Periodic=False, KnotStyle=1)  # -> Curve, Length, Domain
curve_closest_point = CurveClosestPoint(Point=populate_3d, Curve=interpolate.Curve)  # -> Point, Parameter, Distance
smaller_than = SmallerThan(FirstNumber=curve_closest_point.Distance, SecondNumber=Slider(30, range=1..30))  # -> SmallerThan, OrEqualTo
cull_pattern = CullPattern(List=voronoi_3d.Cells, CullPattern=smaller_than.SmallerThan)
solid_union = SolidUnion(Breps=cull_pattern)
mesh = Mesh(solid_union)
weaverbird_s_picture_frame = WeaverbirdsPictureFrame(MeshPolylines=mesh, Distance=Slider(0.6, range=0..1), InsetType=0)
weaverbird_s_mesh_thicken = WeaverbirdsMeshThicken(MeshCurves=weaverbird_s_picture_frame, Distance=Slider(0.15, range=0..1), OffsetType=0)
weaverbird_s_catmull_clark_subdivision = WeaverbirdsCatmullClarkSubdivision(MeshCurves=weaverbird_s_mesh_thicken, Level=Slider(3, range=0..10), SmoothNakedEdges=1)
custom_preview = CustomPreview(Geometry=weaverbird_s_catmull_clark_subdivision, Material=ColourSwatch(SwatchColor=RGB(85, 78, 158)))
